# Grasshopper definition Assignment-01_definition.gh (Grasshopper 1.0.7)
# plug-ins: MeshEdit Components

uv_divisions = GetInteger(Slider(5, range=0..10), AtLeast=1, AtMost=1, Maximum=2147483647, Minimum=-2147483648, TreeAccess=False)
random_seed = GetInteger(Slider(409, range=100..1000), AtLeast=1, AtMost=1, Maximum=2147483647, Minimum=-2147483648, TreeAccess=False)
box_width = GetInteger(Slider(18, range=0..30), AtLeast=1, AtMost=1, Maximum=2147483647, Minimum=-2147483648, TreeAccess=False)
box_length = GetInteger(Slider(18, range=0..20), AtLeast=1, AtMost=1, Maximum=2147483647, Minimum=-2147483648, TreeAccess=False)
box_height = GetInteger(Slider(10, range=0..10), AtLeast=1, AtMost=1, Maximum=2147483647, Minimum=-2147483648, TreeAccess=False)
max_height = GetInteger(Slider(19, range=0..25), AtLeast=1, AtMost=1, Maximum=2147483647, Minimum=-2147483648, TreeAccess=False)
box = CenterBox(Base=PlaneXY(0, 0, 0), X=box_width, Y=box_length, Z=box_height)
debrep = DeconstructBrep(Brep=box)  # -> Faces, Edges, Vertices
facen = FaceNormals(Mesh=debrep.Faces)  # -> Centers, Normals
Z = UnitZ(Factor=1)
angle = Angle(VectorA=Z, VectorB=facen.Normals)  # -> flatten(Angle), Reflex
smaller = SmallerThan(FirstNumber=angle.Angle, SecondNumber="1e-5")  # -> SmallerThan, OrEqualTo
mindex = MemberIndex(Set=smaller.SmallerThan, Member=Toggle(True))  # -> Index, Count
cull_i = CullIndex(List=debrep.Faces, Indices=mindex.Index, Wrap=True)
item = ListItem(List=debrep.Faces, Index=mindex.Index, Wrap=True)
debrep_2 = DeconstructBrep(Brep=item)  # -> Faces, Edges, Vertices
sdivide = DivideSurface(Surface=item, UCount=uv_divisions, VCount=uv_divisions)  # -> Points, Normals, Parameters
dom = ConstructDomain(DomainStart=Slider(0.5, range=0..1), DomainEnd=max_height)
join = JoinCurves(Curves=debrep_2.Edges, Preserve=False)
range = Range(Domain=dom, Steps=10)
pt = Point(simplify(sdivide.Points))
bnd = Bounds(Numbers=range)
crv_cp = CurveClosestPoint(Point=pt, Curve=join)  # -> Point, Parameter, Distance
smaller_2 = SmallerThan(FirstNumber=crv_cp.Distance, SecondNumber="1e-5")  # -> SmallerThan, OrEqualTo
subtraction = Subtraction(A=uv_divisions, B="1")
dispatch = Dispatch(List=pt, DispatchPattern=smaller_2.SmallerThan)  # -> ListA, ListB
series = Series(Start="1", Step=1, Count=subtraction)  # -> graft(Series)
pt_2 = Point(simplify(dispatch.ListA))
pt_3 = Point(simplify(dispatch.ListB))
path = ConstructPath(Indices=series)
lng = ListLength(List=dispatch.ListB)
branch = TreeBranch(Tree=simplify(dispatch.ListB), Path=flatten(path), MaintainPaths=True)
ma = MassAddition(Input=flatten(lng))  # -> Result, PartialResults
sort = SortList(Keys=flatten(lng))  # -> Keys, ValuesA
random = Random(Range=bnd, Number=ma.Result, Seed=random_seed)  # -> simplify(Random)
item_2 = ListItem(List=sort.Keys, Index="-1", Wrap=True)
partition = PartitionList(List=random, Size=item_2)
Z_2 = UnitZ(Factor=partition)
move = Move(Geometry=branch, Motion=Z_2)  # -> Geometry, Transform
match = MatchTree(Tree=move.Geometry, Guide=branch)
merge = Merge(Data1=pt_2, Data2=match)
pdecon = Deconstruct(Point=merge)  # -> XComponent, YComponent, ZComponent
srf = Surface(cull_i)
mesh = Mesh(srf)
addition = Addition(A=uv_divisions, B="1")
sort_2 = SortList(Keys=pdecon.YComponent, ValuesA=merge)  # -> Keys, ValuesA
frompoints = MeshFromPoints(Points=flatten(sort_2.ValuesA), UDirection=addition, VDirection=addition)
merge_2 = Merge(Data1=mesh, Data2=frompoints)
mjoin = MeshJoin(Meshes=flatten(merge_2))
alignvert = AlignVertices(Mesh=mjoin, Tolerance=0.1)  # -> Result, Count
weld = WeldMesh(Mesh=alignvert.Result, Angle=3.141592654)
meshsubd = MeshFromSubD(SubD=weld, Density=2)
weld_2 = WeldMesh(Mesh=meshsubd, Angle=3.141592654)
mjoin_2 = MeshJoin(Meshes=flatten(weld_2))

# ---- group: RH_OUT:RenFloatingTopo
mesh_2 = Mesh(mjoin_2)
context_bake = ContextBake(Geometry=mesh_2)
